# Grasshopper definition findVoxels.gh (Grasshopper 1.0.7)

panel = Panel("Data set")
box = Box([{Plane=Plane(origin=(22.13419724, 27.77519894, -0.249671936), x=(-1, 0, 0), y=(0, -1, 0)), X=Domain(-0.5, 0.5), Y=Domain(-0.5, 0.5), Z=Domain(-0.5, 0.5)}, {Plane=Plane(origin=(69.13419724, 25.77519894, -1.249671936), x=(-1, 0, 0), y=(0, -1, 0)), X=Domain(-0.5, 0.5), Y=Domain(-0.5, 0.5), Z=Domain(-0.5, 0.5)}, {Plane=Plane(origin=(21.13419724, 27.77519894, 8.750328064), x=(-1, 0, 0), y=(0, -1, 0)), X=Domain(-0.5, 0.5), Y=Domain(-0.5, 0.5), Z=Domain(-0.5, 0.5)}, {Plane=Plane(origin=(71.13419724, 24.77519894, -3.249671936), x=(-1, 0, 0), y=(0, -1, 0)), X=Domain(-0.5, 0.5), Y=Domain(-0.5, 0.5), Z=Domain(-0.5, 0.5)}, {Plane=Plane(origin=(62.13419724, 23.77519894, 1.750328064), x=(-1, 0, 0), y=(0, -1, 0)), X=Domain(-0.5, 0.5), Y=Domain(-0.5, 0.5), Z=Domain(-0.5, 0.5)}, {Plane=Plane(origin=(38.13419724, 27.77519894, 7.750328064), x=(-1, 0, 0), y=(0, -1, 0)), X=Domain(-0.5, 0.5), Y=Domain(-0.5, 0.5), Z=Domain(-0.5, 0.5)}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])

c_script = CSharpScript()  # -> out, groupVoxels, loneVoxels; inputs voxels: list of Box
# ---------- c_script: C# ----------
    // Copy the input list of voxels.
    List<Box> copyVoxels = new List<Box>(voxels);

    // We are looking for the midpoints of the voxels.
    List<Point3d> voxelsCent = new List<Point3d>();
    for (int i = 0; i < copyVoxels.Count; i++)
    {
      voxelsCent.Add(copyVoxels[i].Center);
    }
    // We create a list for the lone voxels.
    List<Box> leftVoxels = new List<Box>();

    // We use the created method to create a data tree with groups of voxels
    // And passing on a list of lonely voxels.
    DataTree<Box> voxelsTree = FindVoxelsGroup(copyVoxels, voxelsCent, out leftVoxels);

    groupVoxels = voxelsTree;
    loneVoxels = leftVoxels;
# ---------- c_script: C# additional code ----------
  private DataTree<Box> FindVoxelsGroup(List<Box> voxels, List<Point3d> voxelCenters, out List<Box> leftLoneVoxels)
  {
    int numIter = voxels.Count;
    // We create a data tree for the output with groups of voxels and a list for the output of lone voxels.
    leftLoneVoxels = new List<Box>();
    DataTree<Box> voxelsTree = new DataTree<Box>();
    // We create lists to overwrite the voxels and their midpoints,
    // to disregard the received group or checked voxel in the next iteration.
    List<Box> voxelsLeft = new List<Box>(voxels);
    List<Point3d> voxelCentersLeft = new List<Point3d>(voxelCenters);

    for (int a = 0; a < numIter; a++)
    {
      // We assume that the voxel has no pair and add it to the list with lonely voxels.
      leftLoneVoxels.Add(voxels[0]);

      // List with numbers of grouped voxel indices to search for consecutive pairs.
      List<int> currentIndexes = new List<int>();
      currentIndexes.Add(0); // Add the first voxel for initialising the check.

      // We are creating an array to store whether a voxel belongs to a group.
      int[] allIndexes = new int[voxelCenters.Count];

      // We create a list on which the grouped voxels will be placed.
      List<Box> voxelsList = new List<Box>();

      for (int i = 0; i < voxelCenters.Count; i++)
      {
        for (int j = 0; j < voxelCenters.Count; j++)
        {
          // We check that the voxel is not already in the group.
          if (allIndexes[j] != 1)
          {
            // We check the distance of the centre points of the voxels.
            // Alternatively you can use DistanceTo, but this operation takes more time.
            double distance = DistanceSquared(voxelCenters[currentIndexes[0]], voxelCenters[j]);

            // We check the condition that the distance of the centre points of the voxels is equal to (almost) 1.
            // Which is due to the inaccuracy of the double numeric type.
            if (distance <= 1.00001 && distance >= 0.99999) // Acceptance of error tolerance.
            {
              // We check the second condition that no vertex in the voxel is inside the other.
              Point3d[] voxelCorners = new Point3d[8];
              voxelCorners = voxels[j].GetCorners();
              bool check = false;

              foreach (Point3d voxPoint in voxelCorners)
              {
                if (voxels[0].Contains(voxPoint, true))
                {
                  check = true;
                  break;
                }
              }
              // If the condition is met then we continue, if not then we break the loop.
              if (check) break;

              if(voxelsList.Count == 0)
              {
                // If the list was empty then we also add the voxel against which we searched for the pair.
                // We change the status information of the voxel.
                voxelsList.Add(voxels[i]);
                allIndexes[i] = 1;
              }
              // We add the voxel being checked and its index to the group,
              // to look for more pairs in relation to the voxels found.
              voxelsList.Add(voxels[j]);
              currentIndexes.Add(j);
              // We change the status information of the voxel.
              allIndexes[j] = 1;
            }
          }
        }
        // Every loop, the voxel against which the pair was searched for is removed.
        // To be able to look for pairs of the next voxel (paired against the previous one).
        currentIndexes.RemoveAt(0);

        // If all the voxels in the list have been checked and no new ones have been added,
        // This means that the voxels have no more pairs and we can end the search.
        if (currentIndexes.Count == 0) break;
      }

      // Removing voxel(s) from lists so that they are not taken into account when searching for subsequent groups.
      if (voxelsList.Count == 0)
      {
        voxelsLeft.RemoveAt(0);
        voxelCentersLeft.RemoveAt(0);
      }
      else
      {
        for (int k = allIndexes.Length - 1; k >= 0; k--)
        {
          if (allIndexes[k] == 1)
          {
            voxelsLeft.RemoveAt(k);
            voxelCentersLeft.RemoveAt(k);
          }
        }
      }
      // If there is a voxel group in the list
      if (voxelsList.Count != 0)
      {
        // We add them to the branch of our data tree.
        voxelsTree.AddRange(voxelsList, new GH_Path(a));
        // We remove the voxel from the list of lonely voxels.
        leftLoneVoxels.RemoveAt(leftLoneVoxels.Count - 1);
      }
      // We overwrite the lists with the voxels and their midpoints,
      // so that the next iteration does not take into account the received group or a single voxel.
      voxels = voxelsLeft;
      voxelCenters = voxelCentersLeft;
      // If there are no more voxels left to check, we break the loop
      if (voxels.Count == 0) break;
    }
    // We number the branches of the tree starting from 0.
    voxelsTree.RenumberPaths();

    return voxelsTree;
  }

  double DistanceSquared(Point3d a, Point3d b){
    // Calculate the sides of the triangle.
    double dx = b.X - a.X;
    double dy = b.Y - a.Y;
    double dz = b.Z - a.Z;

    // Calculate the length of the longer side of the triangle squared.
    double d2 = dx * dx + dy * dy + dz * dz;

    // When checking for a length equal to 1, we don't need to perform the heavy Math.Sqrt() operation.
    return d2;
  }
# ---------- end c_script ----------
